% Simulink data dictionary Master_Dictionary.sldd

rGearboxRatio = Simulink.Parameter(15.551)
rTyreRadius = Simulink.Parameter(0.203)
rThrottleCalHigh = Simulink.Parameter(103)
rThrottleCalLow = Simulink.Parameter(-3)
VThrottleErrorHigh = Simulink.Parameter(4900)
rThrottleDeltaError = Simulink.Parameter(10)
tSystemsTask = Simulink.Parameter(0.001)
pBrakeErrorLow = Simulink.Parameter(-10)
pBrakeErrorHigh = Simulink.Parameter(150)
pAppsBrakeThreshold = Simulink.Parameter(10)
pAppsThrottleThreshold = Simulink.Parameter(6.25)
rSteeringAngleCalHigh = Simulink.Parameter(100)
rSteeringAngleCalLow = Simulink.Parameter(-100)
VSteeringAngleHighSample = Simulink.Parameter(3700)
VSteeringAngleLowSample = Simulink.Parameter(1006)
aSteeringAngleMax = Simulink.Parameter(26.557)
rRegenPaddleCalHigh = Simulink.Parameter(103)
rRegenPaddleCalLow = Simulink.Parameter(-3)
xDamperGain = Simulink.Parameter(1)
xDamperOffsetFL = Simulink.Parameter(0)
xDamperOffsetFR = Simulink.Parameter(0)
xDamperOffsetRL = Simulink.Parameter(0)
xDamperOffsetRR = Simulink.Parameter(0)
VDamperErrorLow = Simulink.Parameter(0)
VDamperErrorHigh = Simulink.Parameter(4900)
QAccumulatorCapacity = Simulink.Parameter(48960)
EAccumulatorCapacity = Simulink.Parameter(23544000)
MTotalMaxAllowed = Simulink.Parameter(816.33)
IRegen6C = Simulink.Parameter(-80)
tTorqueControlTask = Simulink.Parameter(0.001)
tMaxRegen = Simulink.Parameter(1.9)
IRegen2C = Simulink.Parameter(-27.2)
NKe = Simulink.Parameter(0.26)
MTotalMinAllowed = Simulink.Parameter(-200)
MNominal = Simulink.Parameter(9.8)
PPowerControllerProportionalLowerLimit = Simulink.Parameter(-10)
NPowerControllerIntegralGain = Simulink.Parameter(0.05)
rEMSTarget = Simulink.Parameter(-3.863)
mCarMass = Simulink.Parameter(315)
zCogHeight = Simulink.Parameter(0.28)
lWheelbase = Simulink.Parameter(1.535)
IYawInertia = Simulink.Parameter(148.66)
lTrackWidth = Simulink.Parameter(1.23)
MMotorMaxAllowed = Simulink.Parameter(204.8)
MMotorMinAllowed = Simulink.Parameter(-100)
rStraightSlipRatio = Simulink.Parameter(0.1)
tSpinLength = Simulink.Parameter(5)
nTargetRPM = Simulink.Parameter(2000)
NSpinningModelKp = Simulink.Parameter(0.01)
MSpin = Simulink.Parameter(5)
nRPMSpinningModelIntegralActivation = Simulink.Parameter(1000)
NSpinningModelKi = Simulink.Parameter(0.05)

InverterRLCANBus = Simulink.Bus()
  nMotorRL: double
  BInvDCOnRL: boolean
  BInvErrorRL: boolean
  BInvOnRL: boolean
  BInvDCQuitInvOnRL: boolean
  BInvQuitInvOnRL: boolean
  BInvSysReadyRL: boolean
  BInvWarnRL: boolean
  MMotorMeasuredRL: double
  NInvDTCRL: double
  TMotorRL: double
  VDCInvRL: double
  TInvRL: double

InverterRRCANBus = Simulink.Bus()
  nMotorRR: double
  BInvDCOnRR: boolean
  BInvErrorRR: boolean
  BInvOnRR: boolean
  BInvDCQuitInvOnRR: boolean
  BInvQuitInvOnRR: boolean
  BInvSysReadyRR: boolean
  BInvWarnRR: boolean
  MMotorMeasuredRR: double
  NInvDTCRR: double
  TMotorRR: double
  VDCInvRR: double
  TInvRR: double

InverterFLCANBus = Simulink.Bus()
  nMotorFL: double
  BInvDCOnFL: boolean
  BInvErrorFL: boolean
  BInvOnFL: boolean
  BInvDCQuitInvOnFL: boolean
  BInvQuitInvOnFL: boolean
  BInvSysReadyFL: boolean
  BInvWarnFL: boolean
  MMotorMeasuredFL: double
  NInvDTCFL: double
  TMotorFL: double
  VDCInvFL: double
  TInvFL: double

InverterFRCANBus = Simulink.Bus()
  nMotorFR: double
  BInvDCOnFR: boolean
  BInvErrorFR: boolean
  BInvOnFR: boolean
  BInvDCQuitInvOnFR: boolean
  BInvQuitInvOnFR: boolean
  BInvSysReadyFR: boolean
  BInvWarnFR: boolean
  MMotorMeasuredFR: double
  NInvDTCFR: double
  TMotorFR: double
  VDCInvFR: double
  TInvFR: double

GPSIMUCANBus = Simulink.Bus()
  vLongitudinalOXTSIMU: double
  gLateralOXTSIMU: double
  gLongitudinalOXTSIMU: double
  nYawRateOXTSIMU: double

PBXCANBus = Simulink.Bus()
  PBXAnalogueCANBus: Bus: PBXAnalogueCANBus
  PBXDigitalCANBus: Bus: PBXDigitalCANBus

BMSCANBus = Simulink.Bus()
  VCellMin: double
  VCellAverage: double
  VCellMax: double
  TCellMax: double
  NBMSDLC: double
  TCellMin: double
  IBMSHallEffect: double
  VDCAccumulator: double
  RCellAverage: double
  BBalancingActive: boolean
  BBMSP0A0C: boolean
  BBMSP0A0E: boolean
  BBMSP0A10: boolean
  BBMSP0A80: boolean
  BBMSP0AC0: boolean
  BBMSP0AFA: boolean
  IIVTS: double

InverterCANBus = Simulink.Bus()
  InverterRLCANBus: Bus: InverterRLCANBus
  InverterRRCANBus: Bus: InverterRRCANBus
  InverterFLCANBus: Bus: InverterFLCANBus
  InverterFRCANBus: Bus: InverterFRCANBus

InverterRLSignalsBus = Simulink.Bus()
  nMotorRL: double
  BInvDCOnRL: boolean
  BInvErrorRL: boolean
  BInvOnRL: boolean
  BInvDCQuitInvOnRL: boolean
  BInvQuitInvOnRL: boolean
  BInvSysReadyRL: boolean
  BInvWarnRL: boolean
  MMotorMeasuredRL: double
  NInvDTCRL: double
  TMotorRL: double
  VDCInvRL: double
  TInvRL: double

InverterFLSignalsBus = Simulink.Bus()
  nMotorFL: double
  BInvDCOnFL: boolean
  BInvErrorFL: boolean
  BInvOnFL: boolean
  BInvDCQuitInvOnFL: boolean
  BInvQuitInvOnFL: boolean
  BInvSysReadyFL: boolean
  BInvWarnFL: boolean
  MMotorMeasuredFL: double
  NInvDTCFL: double
  TMotorFL: double
  VDCInvFL: double
  TInvFL: double

InverterRRSignalsBus = Simulink.Bus()
  nMotorRR: double
  BInvDCOnRR: boolean
  BInvErrorRR: boolean
  BInvOnRR: boolean
  BInvDCQuitInvOnRR: boolean
  BInvQuitInvOnRR: boolean
  BInvSysReadyRR: boolean
  BInvWarnRR: boolean
  MMotorMeasuredRR: double
  NInvDTCRR: double
  TMotorRR: double
  VDCInvRR: double
  TInvRR: double

InverterFRSignalsBus = Simulink.Bus()
  nMotorFR: double
  BInvDCOnFR: boolean
  BInvErrorFR: boolean
  BInvOnFR: boolean
  BInvDCQuitInvOnFR: boolean
  BInvQuitInvOnFR: boolean
  BInvSysReadyFR: boolean
  BInvWarnFR: boolean
  MMotorMeasuredFR: double
  NInvDTCFR: double
  TMotorFR: double
  VDCInvFR: double
  TInvFR: double

InverterSignalsBus = Simulink.Bus()
  InverterRLSignalsBus: Bus: InverterRLSignalsBus
  InverterFLSignalsBus: Bus: InverterFLSignalsBus
  InverterRRSignalsBus: Bus: InverterRRSignalsBus
  InverterFRSignalsBus: Bus: InverterFRSignalsBus

PBXDigitalCANBus = Simulink.Bus()
  NPBXC1P01: double
  NPBXC1P02: double
  NPBXC1P03: double
  NPBXC1P04: double
  NPBXC1P07: double
  NPBXC1P11: double
  NPBXC1P12: double
  NPBXC1P13: double
  NPBXC1P25: double
  NPBXC1P26: double
  NPBXC1P28: double
  NPBXC1P30: double
  NPBXC1P31: double
  NPBXC1P33: double
  NPBXC1P34: double
  NPBXC1P36: double
  NPBXC1P37: double
  NPBXC1P38: double
  NPBXC2P01: double
  NPBXC2P02: double
  NPBXC2P03: double
  NPBXC2P04: double
  NPBXC2P05: double
  NPBXC2P13: double
  NPBXC2P25: double
  NPBXC2P26: double
  NPBXC2P27: double
  NPBXC2P28: double
  NPBXC2P29: double
  NPBXC2P30: double
  NPBXC2P31: double
  NPBXC2P33: double
  NPBXC1P16: double
  NPBXC1P17: double
  NPBXC2P17: double
  NPBXC2P18: double
  NPBXC2P35: double
  NPBXC2P36: double
  NPBXC2P37: double
  NPBXC2P38: double
  ILVSystem: double
  TLVSystem: double
  VLVSystem: double

SensorCANBus = Simulink.Bus()
  pBrakeF: double
  pBrakeR: double
  VDamperPotentiometerFL: double
  VDamperPotentiometerFR: double
  NDisplayNumberDDU7: double
  VSteeringAngle: double
  VThrottlePedal1: double
  VThrottlePedal2: double
  vLongitudinalSOG: double
  BSteeringWheelButton1: boolean
  BSteeringWheelButton2: boolean
  BSteeringWheelButton3: boolean
  BSteeringWheelButton4: boolean
  BSteeringWheelButton5: boolean
  BSteeringWheelButton6: boolean
  BSteeringWheelButton7: boolean
  BSteeringWheelButton8: boolean
  VRegenPaddle1: double
  VRegenPaddle2: double

WheelSpeedsBus = Simulink.Bus()
  vWheelRL: double
  vWheelRR: double
  vWheelFL: double
  vWheelFR: double

GPSIMUSignalsBus = Simulink.Bus()
  vLongitudinalOXTSIMU: double
  gLateralOXTSIMU: double
  gLongitudinalOXTSIMU: double
  nYawRateOXTSIMU: double

BMSSignalsBus = Simulink.Bus()
  VCellMax: double
  VCellDelta: double
  VCellMin: double
  VCellAverage: double
  TCellMax: double
  NBMSDLC: double
  TCellMin: double
  IBMSHallEffect: double
  VDCAccumulator: double
  RCellAverage: double
  BBalancingActive: boolean
  BBMSP0A0C: boolean
  BBMSP0A0E: boolean
  BBMSP0A10: boolean
  BBMSP0A80: boolean
  BBMSP0AC0: boolean
  BBMSP0AFA: boolean
  IIVTS: double

StateflowBus = Simulink.Bus()
  NCarState: double
  BReadyToDriveBuzzer: boolean
  BReadyToDrive: boolean
  NBMSState: double
  NInvState: double
  BHVOn: double
  BInvOnRL: double
  BInvOnRR: double
  BInvOnFL: double
  BInvOnFR: double
  BInvDCOnRL: double
  BInvDCOnRR: double
  BInvDCOnFL: double
  BInvDCOnFR: double
  BInvEnableRL: double
  BInvEnableRR: double
  BInvEnableFL: double
  BInvEnableFR: double
  BInvErrorResetRL: double
  BInvErrorResetRR: double
  BInvErrorResetFL: double
  BInvErrorResetFR: double
  MTargetTorqueRL: double
  MTargetTorqueRR: double
  MTargetTorqueFL: double
  MTargetTorqueFR: double
  MTorqueLimitNegativeRL: double
  MTorqueLimitNegativeRR: double
  MTorqueLimitNegativeFL: double
  MTorqueLimitNegativeFR: double
  MTorqueLimitPositiveRL: double
  MTorqueLimitPositiveRR: double
  MTorqueLimitPositiveFL: double
  MTorqueLimitPositiveFR: double

Global = Simulink.Bus()
  InverterSignalsBus: Bus: InverterSignalsBus
  WheelSpeedsBus: Bus: WheelSpeedsBus
  SensorSignalsBus: Bus: SensorSignalsBus
  GPSIMUSignalsBus: Bus: GPSIMUSignalsBus
  BMSSignalsBus: Bus: BMSSignalsBus
  SystemsBus: Bus: SystemsBus
  StateflowBus: Bus: StateflowBus
  LimitationsBus: Bus: LimitationsBus
  TorqueControlBus: Bus: TorqueControlBus

PPowerControllerIntegralTermActivation = Simulink.Parameter(70)

LimitationsBus = Simulink.Bus()
  BDischargeAllowed: boolean
  rInvTemperatureDerate: double
  rInvTemperatureDerateFR: double
  rInvTemperatureDerateFL: double
  rInvTemperatureDerateRR: double
  rInvTemperatureDerateRL: double
  rMotorTemperatureDerate: double
  rMotorTemperatureDerateFR: double
  rMotorTemperatureDerateFL: double
  rMotorTemperatureDerateRR: double
  rMotorTemperatureDerateRL: double
  rTSTemperatureDerateFR: double
  rTSTemperatureDerateFL: double
  rTSTemperatureDerateRR: double
  rTSTemperatureDerateRL: double
  rHighCellTemperatureDischargeDerate: double
  rHighCellTemperatureRegenDerate: double
  rLowCellVoltageDischargeDerate: double
  rSOCDischargeDerate: double
  rSOCRegenDerate: double
  rSpeedRegenDerate: double
  rDischargeDerate: double
  rRegenDerate: double

FStaticWeightFront = Simulink.Parameter(927)
FStaticWeightRear = Simulink.Parameter(2163)
tTorqueVectoringErrorCorrection = Simulink.Parameter(0.3)

PBXAnalogueCANBus = Simulink.Bus()
  VDamperPotentiometerRR: double
  VDamperPotentiometerRL: double
  VRadiatorOutSensor: double
  VMotorRLOutSensor: double
  VMotorRLInSensor: double
  VMotorFLOutSensor: double

PPowerControllerIntegralLowerLimit = Simulink.Parameter(-8)
IMaxAllowed = Simulink.Parameter(195)
nMotorMax = Simulink.Parameter(22500)
v1stTorqueSplitAdjustment = Simulink.Parameter(4)
PPowerControllerProportionalUpperLimit = Simulink.Parameter(6)
PPowerControllerIntegralUpperLimit = Simulink.Parameter(3)
PPowerControllerActivation = Simulink.Parameter(70)
VThrottle1LowSample = Simulink.Parameter(830)
VThrottleErrorLow = Simulink.Parameter(50)
rThrottleOverlapThreshold = Simulink.Parameter(0)
VThrottle2HighSample = Simulink.Parameter(3230)
VThrottle2LowSample = Simulink.Parameter(350)
VThrottle1HighSample = Simulink.Parameter(4600)
VRegenPaddle1LowSample = Simulink.Parameter(1.4)
VRegenPaddle1HighSample = Simulink.Parameter(1.5)
VRegenPaddle2LowSample = Simulink.Parameter(1.4)
VRegenPaddle2HighSample = Simulink.Parameter(1.5)

SystemsBus = Simulink.Bus()
  rThrottlePedal: double
  BThrottleError: boolean
  tThrottleError: double
  BBrakeError: boolean
  tBrakeError: double
  BBrakeOn: boolean
  pBrakeMax: double
  BPedalOverlap: boolean
  tPedalOverlap: double
  BAppsOK: boolean
  tAppsTimer: double
  rSteeringAngle: double
  aSteeringAngle: double
  rRegenPaddle: double
  BRegenOn: boolean
  BBrakeLight: boolean
  xDamperFL: double
  xDamperFR: double
  xDamperRL: double
  xDamperRR: double
  BDamperErrorFL: boolean
  BDamperErrorFR: boolean
  BDamperErrorRL: boolean
  BDamperErrorRR: boolean
  vChassis: double
  sChassis: double
  sEMS1000m: double
  BEMS1000mPoint: boolean
  BEMS995mPoint: boolean
  BTorqueVectoringActivated: boolean
  NThrottleMap: double
  PDischarge: double
  BEMSActivated: boolean
  PRegen: double
  rTorqueSplit: double
  PEngineBraking: double
  BSpinningModelActivated: boolean
  NTractionControlKpSelector: double
  BTractionControlActivated: boolean
  rTorqueVectoringMultiplier: double
  NPowerControllerKpSelector: double
  NTorqueSplitSpeedSelector: double
  BAccumulatorFanOn: boolean
  BErrorReset: boolean
  BReadyToDriveButton: boolean
  NModeNumberDisplay5: double
  NModeNumberDisplay6: double
  TMotorMax: double
  TInvMax: double
  PActual: double
  rSOC: double
  rSOE: double
  BEncoderErrorRear: boolean
  BEncoderErrorFront: boolean
  rCoolingFansDuty: double
  rCoolingPumpsDuty: double
  BAccumulatorFanDuty: boolean
  BInvLVOn: boolean
  rThrottlePedal1: double
  rThrottlePedal2: double

pBrakeOverlapThreshold = Simulink.Parameter(1.5)
InverterRRBus = Simulink.Signal()

CAN3Bus = Simulink.Bus()
  DDU7_Analoge_1: Bus: DDU7_Analoge_1
  DDU7_Analoge_2: Bus: DDU7_Analoge_2
  OXTSDataFrame1540: Bus: OXTSDataFrame1540
  OXTSDataFrame1541: Bus: OXTSDataFrame1541
  OXTSDataFrame1544: Bus: OXTSDataFrame1544
  PDM_Status_1: Bus: PDM_Status_1
  PDM_Status_2: Bus: PDM_Status_2
  PDM_Status_3: Bus: PDM_Status_3
  PDM_Analoge_1: Bus: PDM_Analoge_1
  PDM_Analoge_2: Bus: PDM_Analoge_2
  PDM_Analoge_3: Bus: PDM_Analoge_3
  SteeringWheelBus: Bus: SteeringWheelBus

OXTSDataFrame1540 = Simulink.Bus()
  vLateralOXTSIMU: double
  vLongitudinalOXTSIMU: double

OXTSDataFrame1541 = Simulink.Bus()
  gLateralOXTS: double
  gLongitudinalOXTS: double
  gVerticalOXTS: double

PDM_Status_1 = Simulink.Bus()
  C1P01_Status: double
  C1P02_Status: double
  C1P03_Status: double
  C1P04_Status: double
  C1P07_Status: double
  C1P11_Status: double
  C1P12_Status: double
  C1P13_Status: double
  C1P25_Status: double
  C1P26_Status: double
  C1P28_Status: double
  C1P30_Status: double
  C1P31_Status: double
  C1P33_Status: double
  C1P34_Status: double
  C1P36_Status: double

PDM_Status_2 = Simulink.Bus()
  C1P37_Status: double
  C1P38_Status: double
  C2P01_Status: double
  C2P02_Status: double
  C2P03_Status: double
  C2P04_Status: double
  C2P05_Status: double
  C2P13_Status: double
  C2P25_Status: double
  C2P26_Status: double
  C2P27_Status: double
  C2P28_Status: double
  C2P29_Status: double
  C2P30_Status: double
  C2P31_Status: double
  C2P33_Status: double

CAN1_2Bus = Simulink.Bus()
  InverterFLCANBus: Bus: InverterFLCANBus
  InverterFRCANBus: Bus: InverterFRCANBus
  InverterRLCANBus: Bus: InverterRLCANBus
  InverterRRCANBus: Bus: InverterRRCANBus

CAN4Bus = Simulink.Bus()
  IIVTS: double
  IBMSHallEffect: double
  VDCAccumulator: double
  TCellMin: double
  VCellAverage: double
  VCellMax: double
  TCellMax: double
  NBMSDLC: double
  VCellMin: double
  RCellAverage: double
  BBalancingActive: double
  BBMSP0A0C: double
  BBMSP0A0E: double
  BBMSP0A10: double
  BBMSP0A80: double
  BBMSP0AC0: double
  BBMSP0AFA: double

SensorSignalsBus = Simulink.Bus()
  pBrakeF: double
  pBrakeR: double
  VDamperPotentiometerFL: double
  VDamperPotentiometerFR: double
  NDisplayNumberDDU7: double
  VSteeringAngle: double
  VThrottlePedal1: double
  VThrottlePedal2: double
  BSteeringWheelButton1: boolean
  BSteeringWheelButton2: boolean
  BSteeringWheelButton3: boolean
  BSteeringWheelButton4: boolean
  BSteeringWheelButton5: boolean
  BSteeringWheelButton6: boolean
  BSteeringWheelButton7: boolean
  BSteeringWheelButton8: boolean
  VRegenPaddle1: double
  VRegenPaddle2: double
  C1P01_Status: double
  C1P02_Status: double
  C1P03_Status: double
  C1P04_Status: double
  C1P07_Status: double
  C1P11_Status: double
  C1P12_Status: double
  C1P13_Status: double
  C1P25_Status: double
  C1P26_Status: double
  C1P28_Status: double
  C1P30_Status: double
  C1P31_Status: double
  C1P33_Status: double
  C1P34_Status: double
  C1P36_Status: double
  C1P37_Status: double
  C1P38_Status: double
  C2P01_Status: double
  C2P02_Status: double
  C2P03_Status: double
  C2P04_Status: double
  C2P05_Status: double
  C2P13_Status: double
  C2P25_Status: double
  C2P26_Status: double
  C2P27_Status: double
  C2P28_Status: double
  C2P29_Status: double
  C2P30_Status: double
  C2P31_Status: double
  C2P33_Status: double
  C1P16_Digital: double
  C1P17_Digital: double
  C2P17_Digital: double
  C2P18_Digital: double
  C2P35_Status: double
  C2P36_Status: double
  C2P37_Status: double
  C2P38_Status: double
  ILVSystem: double
  TLVSystem: double
  VLVSystem: double
  VDamperPotentiometerRL: double
  VDamperPotentiometerRR: double

SteeringWheelBus = Simulink.Bus()
  BSteeringWheelButton1: boolean
  BSteeringWheelButton2: boolean
  BSteeringWheelButton3: boolean
  BSteeringWheelButton4: boolean
  BSteeringWheelButton5: boolean
  BSteeringWheelButton6: boolean
  BSteeringWheelButton7: boolean
  BSteeringWheelButton8: boolean
  VRegenPaddle1: double
  VRegenPaddle2: double

DDU7_Analoge_2 = Simulink.Bus()
  NDisplayNumberDDU7: double
  VSteeringAngle: double
  VThrottlePedal1: double
  VThrottlePedal2: double

TorqueControlBus = Simulink.Bus()
  MDriverDischargeRequested: double
  MDriverRegenRequested: double
  MDischargeLimited: double
  MRegenLimited: double
  PPowerControllerRequested: double
  MPowerControllerRequested: double
  PPowerControllerProportionalTerm: double
  PPowerControllerIntegralTerm: double
  PDischargeLimited: double
  MTotalRequested: double
  MTotalEMSRequested: double
  rSOCTargetError: double
  rSOETargetError: double
  nYawRateErrorActual: double
  BTorqueVectoringOK: boolean
  MTorqueVectoringFL: double
  MTorqueVectoringFR: double
  MTorqueVectoringRL: double
  MTorqueVectoringRR: double
  rSplitRear: double
  MTorqueDistributionFL: double
  MTorqueDistributionFR: double
  MTorqueDistributionRL: double
  MTorqueDistributionRR: double
  rSlipRatioOptimal: double
  NTractionControlMultiplierFL: double
  NTractionControlMultiplierFR: double
  NTractionControlMultiplierRL: double
  NTractionControlMultiplierRR: double
  NABSMultiplierFL: double
  NABSMultiplierFR: double
  NABSMultiplierRL: double
  NABSMultiplierRR: double
  rSlipRatioFLActual: double
  rSlipRatioFRActual: double
  rSlipRatioRLActual: double
  rSlipRatioRRActual: double
  MTractionControlFLTotal: double
  MTractionControlFRTotal: double
  MTractionControlRLTotal: double
  MTractionControlRRTotal: double
  MTractionControlFLFinal: double
  MTractionControlFRFinal: double
  MTractionControlRLFinal: double
  MTractionControlRRFinal: double
  MSpinningModelFL: double
  MSpinningModelFR: double
  MSpinningModelRL: double
  MSpinningModelRR: double
  MFLFinal: double
  MFRFinal: double
  MRLFinal: double
  MRRFinal: double
  MTotalFinal: double

PDM_Status_3 = Simulink.Bus()
  C1P16_Digital: double
  C1P17_Digital: double
  C2P17_Digital: double
  C2P18_Digital: double
  C2P35_Status: double
  C2P36_Status: double
  C2P37_Status: double
  C2P38_Status: double
  ILVSystem: double
  TLVSystem: double
  VLVSystem: double

OXTSDataFrame1544 = Simulink.Bus()
  nPitchRateOXTSIMU: double
  nRollRateOXTSIMU: double
  nYawRateOXTSIMU: double

PDM_Analoge_3 = Simulink.Bus()
  C1P18_AnalogInput09: double
  C1P19_AnalogInput10: double
  C1P32_AnalogInput11: double
  C1P35_AnalogInput12: double

PDM_Analoge_1 = Simulink.Bus()
  C1P14_AnalogInput03: double
  C1P15_AnalogInput04: double
  C2P15_AnalogInput01: double
  C2P16_AnalogInput02: double

PDM_Analoge_2 = Simulink.Bus()
  C1P05_AnalogInput07: double
  C1P06_AnalogInput08: double
  C1P27_AnalogInput05: double
  C1P29_AnalogInput06: double

DDU7_Analoge_1 = Simulink.Bus()
  pBrakeF: double
  pBrakeR: double
  VDamperPotentiometerFL: double
  VDamperPotentiometerFR: double
  VDamperPotentiometerRL: double
  VDamperPotentiometerRR: double

CAN_MESSAGE_def = Simulink.Bus()
  ID: uint32
  Extended: boolean
  Remote: boolean
  Error: boolean
  Length: double
  Data: uint8[8]

STM32H7_Config = Simulink.ConfigSet(StartTime="0", StopTime="1", FixedStep="0.0005", Solver="FixedStepDiscrete", ProdHWDeviceType="ARM Compatible->ARM Cortex-M", SystemTargetFile="ert.tlc", HardwareBoard="STM32H7xx Based (Single-core)", TargetLang="C")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