% Simulink data dictionary Master_Dictionary.sldd

rGearboxRatio = Simulink.Parameter(15.551)
rTyreRadius = Simulink.Parameter(0.203)
rThrottleCalHigh = Simulink.Parameter(103)
rThrottleCalLow = Simulink.Parameter(-3)
VThrottleErrorHigh = Simulink.Parameter(4900)
rThrottleDeltaError = Simulink.Parameter(10)
tSystemsTask = Simulink.Parameter(0.001)
pBrakeErrorLow = Simulink.Parameter(-10)
pBrakeErrorHigh = Simulink.Parameter(150)
pAppsBrakeThreshold = Simulink.Parameter(10)
pAppsThrottleThreshold = Simulink.Parameter(6.25)
rSteeringAngleCalHigh = Simulink.Parameter(100)
rSteeringAngleCalLow = Simulink.Parameter(-100)
VSteeringAngleHighSample = Simulink.Parameter(3700)
VSteeringAngleLowSample = Simulink.Parameter(1006)
aSteeringAngleMax = Simulink.Parameter(26.557)
rRegenPaddleCalHigh = Simulink.Parameter(103)
rRegenPaddleCalLow = Simulink.Parameter(-3)
VDamperErrorLow = Simulink.Parameter(0)
VDamperErrorHigh = Simulink.Parameter(4900)
tTorqueControlTask = Simulink.Parameter(0.001)
NKe = Simulink.Parameter(0.26)
MNominal = Simulink.Parameter(9.8)
rEMSTarget = Simulink.Parameter(-3.863)
IYawInertia = Simulink.Parameter(148.66)
MMotorMaxAllowed = Simulink.Parameter(204.8)
rStraightSlipRatio = Simulink.Parameter(0.1)
tSpinLength = Simulink.Parameter(5)
nTargetRPM = Simulink.Parameter(2000)
NSpinningModelKp = Simulink.Parameter(0.01)
MSpin = Simulink.Parameter(5)
nRPMSpinningModelIntegralActivation = Simulink.Parameter(1000)
NSpinningModelKi = Simulink.Parameter(0.05)

InverterRLCANBus = Simulink.Bus()
  nMotorRL: double
  BInvDCOnRL: boolean
  BInvErrorRL: boolean
  BInvOnRL: boolean
  BInvDCQuitInvOnRL: boolean
  BInvQuitInvOnRL: boolean
  BInvSysReadyRL: boolean
  BInvWarnRL: boolean
  MMotorMeasuredRL: double
  NInvDTCRL: double
  TMotorRL: double
  VDCInvRL: double
  TInvRL: double

InverterRRCANBus = Simulink.Bus()
  nMotorRR: double
  BInvDCOnRR: boolean
  BInvErrorRR: boolean
  BInvOnRR: boolean
  BInvDCQuitInvOnRR: boolean
  BInvQuitInvOnRR: boolean
  BInvSysReadyRR: boolean
  BInvWarnRR: boolean
  MMotorMeasuredRR: double
  NInvDTCRR: double
  TMotorRR: double
  VDCInvRR: double
  TInvRR: double

InverterFLCANBus = Simulink.Bus()
  nMotorFL: double
  BInvDCOnFL: boolean
  BInvErrorFL: boolean
  BInvOnFL: boolean
  BInvDCQuitInvOnFL: boolean
  BInvQuitInvOnFL: boolean
  BInvSysReadyFL: boolean
  BInvWarnFL: boolean
  MMotorMeasuredFL: double
  NInvDTCFL: double
  TMotorFL: double
  VDCInvFL: double
  TInvFL: double

InverterFRCANBus = Simulink.Bus()
  nMotorFR: double
  BInvDCOnFR: boolean
  BInvErrorFR: boolean
  BInvOnFR: boolean
  BInvDCQuitInvOnFR: boolean
  BInvQuitInvOnFR: boolean
  BInvSysReadyFR: boolean
  BInvWarnFR: boolean
  MMotorMeasuredFR: double
  NInvDTCFR: double
  TMotorFR: double
  VDCInvFR: double
  TInvFR: double

GPSIMUCANBus = Simulink.Bus()
  vLongitudinalOXTSIMU: double
  gLateralOXTSIMU: double
  gLongitudinalOXTSIMU: double
  nYawRateOXTSIMU: double

PBXCANBus = Simulink.Bus()
  PBXAnalogueCANBus: Bus: PBXAnalogueCANBus
  PBXDigitalCANBus: Bus: PBXDigitalCANBus

BMSCANBus = Simulink.Bus()
  VCellMin: double
  VCellAverage: double
  VCellMax: double
  TCellMax: double
  NBMSDLC: double
  TCellMin: double
  IBMSHallEffect: double
  VDCAccumulator: double
  RCellAverage: double
  BBalancingActive: boolean
  BBMSP0A0C: boolean
  BBMSP0A0E: boolean
  BBMSP0A10: boolean
  BBMSP0A80: boolean
  BBMSP0AC0: boolean
  BBMSP0AFA: boolean
  IIVTS: double

InverterCANBus = Simulink.Bus()
  InverterRLCANBus: Bus: InverterRLCANBus
  InverterRRCANBus: Bus: InverterRRCANBus
  InverterFLCANBus: Bus: InverterFLCANBus
  InverterFRCANBus: Bus: InverterFRCANBus

InverterRLSignalsBus = Simulink.Bus()
  nMotorRL: double
  BInvDCOnRL: boolean
  BInvErrorRL: boolean
  BInvOnRL: boolean
  BInvDCQuitInvOnRL: boolean
  BInvQuitInvOnRL: boolean
  BInvSysReadyRL: boolean
  BInvWarnRL: boolean
  MMotorMeasuredRL: double
  NInvDTCRL: double
  TMotorRL: double
  VDCInvRL: double
  TInvRL: double

InverterFLSignalsBus = Simulink.Bus()
  nMotorFL: double
  BInvDCOnFL: boolean
  BInvErrorFL: boolean
  BInvOnFL: boolean
  BInvDCQuitInvOnFL: boolean
  BInvQuitInvOnFL: boolean
  BInvSysReadyFL: boolean
  BInvWarnFL: boolean
  MMotorMeasuredFL: double
  NInvDTCFL: double
  TMotorFL: double
  VDCInvFL: double
  TInvFL: double

InverterRRSignalsBus = Simulink.Bus()
  nMotorRR: double
  BInvDCOnRR: boolean
  BInvErrorRR: boolean
  BInvOnRR: boolean
  BInvDCQuitInvOnRR: boolean
  BInvQuitInvOnRR: boolean
  BInvSysReadyRR: boolean
  BInvWarnRR: boolean
  MMotorMeasuredRR: double
  NInvDTCRR: double
  TMotorRR: double
  VDCInvRR: double
  TInvRR: double

InverterFRSignalsBus = Simulink.Bus()
  nMotorFR: double
  BInvDCOnFR: boolean
  BInvErrorFR: boolean
  BInvOnFR: boolean
  BInvDCQuitInvOnFR: boolean
  BInvQuitInvOnFR: boolean
  BInvSysReadyFR: boolean
  BInvWarnFR: boolean
  MMotorMeasuredFR: double
  NInvDTCFR: double
  TMotorFR: double
  VDCInvFR: double
  TInvFR: double

InverterSignalsBus = Simulink.Bus()
  InverterRLSignalsBus: Bus: InverterRLSignalsBus
  InverterFLSignalsBus: Bus: InverterFLSignalsBus
  InverterRRSignalsBus: Bus: InverterRRSignalsBus
  InverterFRSignalsBus: Bus: InverterFRSignalsBus

PBXDigitalCANBus = Simulink.Bus()
  NPBXC1P01: double
  NPBXC1P02: double
  NPBXC1P03: double
  NPBXC1P04: double
  NPBXC1P07: double
  NPBXC1P11: double
  NPBXC1P12: double
  NPBXC1P13: double
  NPBXC1P25: double
  NPBXC1P26: double
  NPBXC1P28: double
  NPBXC1P30: double
  NPBXC1P31: double
  NPBXC1P33: double
  NPBXC1P34: double
  NPBXC1P36: double
  NPBXC1P37: double
  NPBXC1P38: double
  NPBXC2P01: double
  NPBXC2P02: double
  NPBXC2P03: double
  NPBXC2P04: double
  NPBXC2P05: double
  NPBXC2P13: double
  NPBXC2P25: double
  NPBXC2P26: double
  NPBXC2P27: double
  NPBXC2P28: double
  NPBXC2P29: double
  NPBXC2P30: double
  NPBXC2P31: double
  NPBXC2P33: double
  NPBXC1P16: double
  NPBXC1P17: double
  NPBXC2P17: double
  NPBXC2P18: double
  NPBXC2P35: double
  NPBXC2P36: double
  NPBXC2P37: double
  NPBXC2P38: double
  ILVSystem: double
  TLVSystem: double
  VLVSystem: double

SensorCANBus = Simulink.Bus()
  pBrakeF: double
  pBrakeR: double
  VDamperPotentiometerFL: double
  VDamperPotentiometerFR: double
  NDisplayNumberDDU7: double
  VSteeringAngle: double
  VThrottlePedal1: double
  VThrottlePedal2: double
  vLongitudinalSOG: double
  BSteeringWheelButton1: boolean
  BSteeringWheelButton2: boolean
  BSteeringWheelButton3: boolean
  BSteeringWheelButton4: boolean
  BSteeringWheelButton5: boolean
  BSteeringWheelButton6: boolean
  BSteeringWheelButton7: boolean
  BSteeringWheelButton8: boolean
  VRegenPaddle1: double
  VRegenPaddle2: double

WheelSpeedsBus = Simulink.Bus()
  vWheelRL: double
  vWheelRR: double
  vWheelFL: double
  vWheelFR: double

GPSIMUSignalsBus = Simulink.Bus()
  vLongitudinalOXTSIMU: double
  gLateralOXTSIMU: double
  gLongitudinalOXTSIMU: double
  nYawRateOXTSIMU: double

BMSSignalsBus = Simulink.Bus()
  VCellMax: double
  VCellDelta: double
  VCellMin: double
  VCellAverage: double
  TCellMax: double
  NBMSDLC: double
  TCellMin: double
  IBMSHallEffect: double
  VDCAccumulator: double
  RCellAverage: double
  BBalancingActive: boolean
  BBMSP0A0C: boolean
  BBMSP0A0E: boolean
  BBMSP0A10: boolean
  BBMSP0A80: boolean
  BBMSP0AC0: boolean
  BBMSP0AFA: boolean
  IIVTS: double

StateflowBus = Simulink.Bus()
  NCarState: double
  BReadyToDriveBuzzer: boolean
  BReadyToDrive: boolean
  NBMSState: double
  NInvState: double
  BHVOn: double
  BInvOnRL: double
  BInvOnRR: double
  BInvOnFL: double
  BInvOnFR: double
  BInvDCOnRL: double
  BInvDCOnRR: double
  BInvDCOnFL: double
  BInvDCOnFR: double
  BInvEnableRL: double
  BInvEnableRR: double
  BInvEnableFL: double
  BInvEnableFR: double
  BInvErrorResetRL: double
  BInvErrorResetRR: double
  BInvErrorResetFL: double
  BInvErrorResetFR: double
  MTargetTorqueRL: double
  MTargetTorqueRR: double
  MTargetTorqueFL: double
  MTargetTorqueFR: double
  MTorqueLimitNegativeRL: double
  MTorqueLimitNegativeRR: double
  MTorqueLimitNegativeFL: double
  MTorqueLimitNegativeFR: double
  MTorqueLimitPositiveRL: double
  MTorqueLimitPositiveRR: double
  MTorqueLimitPositiveFL: double
  MTorqueLimitPositiveFR: double

Global = Simulink.Bus()
  InverterSignalsBus: Bus: InverterSignalsBus
  WheelSpeedsBus: Bus: WheelSpeedsBus
  SensorSignalsBus: Bus: SensorSignalsBus
  GPSIMUSignalsBus: Bus: GPSIMUSignalsBus
  BMSSignalsBus: Bus: BMSSignalsBus
  SystemsBus: Bus: SystemsBus
  StateflowBus: Bus: StateflowBus
  LimitationsBus: Bus: LimitationsBus
  TorqueControlBus: Bus: TorqueControlBus

PBXAnalogueCANBus = Simulink.Bus()
  VDamperPotentiometerRR: double
  VDamperPotentiometerRL: double
  VRadiatorOutSensor: double
  VMotorRLOutSensor: double
  VMotorRLInSensor: double
  VMotorFLOutSensor: double

IMaxAllowed = Simulink.Parameter(195)
nMotorMax = Simulink.Parameter(22500)
v1stTorqueSplitAdjustment = Simulink.Parameter(4)
PPowerControllerActivation = Simulink.Parameter(70)
VThrottle1LowSample = Simulink.Parameter(830)
VThrottleErrorLow = Simulink.Parameter(50)
rThrottleOverlapThreshold = Simulink.Parameter(0)
VThrottle2HighSample = Simulink.Parameter(3230)
VThrottle2LowSample = Simulink.Parameter(350)
VThrottle1HighSample = Simulink.Parameter(4600)
VRegenPaddle1LowSample = Simulink.Parameter(1.4)
VRegenPaddle1HighSample = Simulink.Parameter(1.5)
VRegenPaddle2LowSample = Simulink.Parameter(1.4)
VRegenPaddle2HighSample = Simulink.Parameter(1.5)
pBrakeOverlapThreshold = Simulink.Parameter(1.5)
InverterRRBus = Simulink.Signal()

CAN3Bus = Simulink.Bus()
  DDU7_Analoge_1: Bus: DDU7_Analoge_1
  DDU7_Analoge_2: Bus: DDU7_Analoge_2
  OXTSDataFrame1540: Bus: OXTSDataFrame1540
  OXTSDataFrame1541: Bus: OXTSDataFrame1541
  OXTSDataFrame1544: Bus: OXTSDataFrame1544
  PDM_Status_1: Bus: PDM_Status_1
  PDM_Status_2: Bus: PDM_Status_2
  PDM_Status_3: Bus: PDM_Status_3
  PDM_Analoge_1: Bus: PDM_Analoge_1
  PDM_Analoge_2: Bus: PDM_Analoge_2
  PDM_Analoge_3: Bus: PDM_Analoge_3
  SteeringWheelBus: Bus: SteeringWheelBus

OXTSDataFrame1540 = Simulink.Bus()
  vLateralOXTSIMU: double
  vLongitudinalOXTSIMU: double

OXTSDataFrame1541 = Simulink.Bus()
  gLateralOXTS: double
  gLongitudinalOXTS: double
  gVerticalOXTS: double

PDM_Status_1 = Simulink.Bus()
  C1P01_Status: double
  C1P02_Status: double
  C1P03_Status: double
  C1P04_Status: double
  C1P07_Status: double
  C1P11_Status: double
  C1P12_Status: double
  C1P13_Status: double
  C1P25_Status: double
  C1P26_Status: double
  C1P28_Status: double
  C1P30_Status: double
  C1P31_Status: double
  C1P33_Status: double
  C1P34_Status: double
  C1P36_Status: double

PDM_Status_2 = Simulink.Bus()
  C1P37_Status: double
  C1P38_Status: double
  C2P01_Status: double
  C2P02_Status: double
  C2P03_Status: double
  C2P04_Status: double
  C2P05_Status: double
  C2P13_Status: double
  C2P25_Status: double
  C2P26_Status: double
  C2P27_Status: double
  C2P28_Status: double
  C2P29_Status: double
  C2P30_Status: double
  C2P31_Status: double
  C2P33_Status: double

CAN1_2Bus = Simulink.Bus()
  InverterFLCANBus: Bus: InverterFLCANBus
  InverterFRCANBus: Bus: InverterFRCANBus
  InverterRLCANBus: Bus: InverterRLCANBus
  InverterRRCANBus: Bus: InverterRRCANBus

CAN4Bus = Simulink.Bus()
  IIVTS: double
  IBMSHallEffect: double
  VDCAccumulator: double
  TCellMin: double
  VCellAverage: double
  VCellMax: double
  TCellMax: double
  NBMSDLC: double
  VCellMin: double
  RCellAverage: double
  BBalancingActive: double
  BBMSP0A0C: double
  BBMSP0A0E: double
  BBMSP0A10: double
  BBMSP0A80: double
  BBMSP0AC0: double
  BBMSP0AFA: double

SensorSignalsBus = Simulink.Bus()
  pBrakeF: double
  pBrakeR: double
  VDamperPotentiometerFL: double
  VDamperPotentiometerFR: double
  NDisplayNumberDDU7: double
  VSteeringAngle: double
  VThrottlePedal1: double
  VThrottlePedal2: double
  BSteeringWheelButton1: boolean
  BSteeringWheelButton2: boolean
  BSteeringWheelButton3: boolean
  BSteeringWheelButton4: boolean
  BSteeringWheelButton5: boolean
  BSteeringWheelButton6: boolean
  BSteeringWheelButton7: boolean
  BSteeringWheelButton8: boolean
  VRegenPaddle1: double
  VRegenPaddle2: double
  C1P01_Status: double
  C1P02_Status: double
  C1P03_Status: double
  C1P04_Status: double
  C1P07_Status: double
  C1P11_Status: double
  C1P12_Status: double
  C1P13_Status: double
  C1P25_Status: double
  C1P26_Status: double
  C1P28_Status: double
  C1P30_Status: double
  C1P31_Status: double
  C1P33_Status: double
  C1P34_Status: double
  C1P36_Status: double
  C1P37_Status: double
  C1P38_Status: double
  C2P01_Status: double
  C2P02_Status: double
  C2P03_Status: double
  C2P04_Status: double
  C2P05_Status: double
  C2P13_Status: double
  C2P25_Status: double
  C2P26_Status: double
  C2P27_Status: double
  C2P28_Status: double
  C2P29_Status: double
  C2P30_Status: double
  C2P31_Status: double
  C2P33_Status: double
  C1P16_Digital: double
  C1P17_Digital: double
  C2P17_Digital: double
  C2P18_Digital: double
  C2P35_Status: double
  C2P36_Status: double
  C2P37_Status: double
  C2P38_Status: double
  ILVSystem: double
  TLVSystem: double
  VLVSystem: double
  VDamperPotentiometerRL: double
  VDamperPotentiometerRR: double

SteeringWheelBus = Simulink.Bus()
  BSteeringWheelButton1: boolean
  BSteeringWheelButton2: boolean
  BSteeringWheelButton3: boolean
  BSteeringWheelButton4: boolean
  BSteeringWheelButton5: boolean
  BSteeringWheelButton6: boolean
  BSteeringWheelButton7: boolean
  BSteeringWheelButton8: boolean
  VRegenPaddle1: double
  VRegenPaddle2: double

DDU7_Analoge_2 = Simulink.Bus()
  NDisplayNumberDDU7: double
  VSteeringAngle: double
  VThrottlePedal1: double
  VThrottlePedal2: double

PPowerControllerProportionalLowerLimit = Simulink.Parameter(-10)
NPowerControllerIntegralGain = Simulink.Parameter(0.05)
PPowerControllerIntegralTermActivation = Simulink.Parameter(70)
PPowerControllerIntegralLowerLimit = Simulink.Parameter(-8)
PPowerControllerProportionalUpperLimit = Simulink.Parameter(6)
PPowerControllerIntegralUpperLimit = Simulink.Parameter(3)
lWheelbase = Simulink.Parameter(1.535)
MMotorMinAllowed = Simulink.Parameter(-100)
FStaticWeightFront = Simulink.Parameter(927)
FStaticWeightRear = Simulink.Parameter(2163)
tTorqueVectoringErrorCorrection = Simulink.Parameter(0.3)
tMaxRegen = Simulink.Parameter(1.9)
IRegen2C = Simulink.Parameter(-27.2)
xDamperGain = Simulink.Parameter(1)
xDamperOffsetFL = Simulink.Parameter(0)
xDamperOffsetFR = Simulink.Parameter(0)
xDamperOffsetRL = Simulink.Parameter(0)
xDamperOffsetRR = Simulink.Parameter(0)
QAccumulatorCapacity = Simulink.Parameter(48960)
EAccumulatorCapacity = Simulink.Parameter(23544000)

OXTSDataFrame1544 = Simulink.Bus()
  nYawRateOXTSIMU: double
  nPitchRateOXTSIMU: double
  nRollRateOXTSIMU: double

PDM_Analoge_1 = Simulink.Bus()
  C1P14_AnalogeInput03: double
  C1P15_AnalogeInput04: double
  C2P15_AnalogeInput01: double
  C2P16_AnalogeInput02: double

PDM_Analoge_2 = Simulink.Bus()
  C1P05_AnalogeInput07: double
  C1P06_AnalogeInput08: double
  C1P27_AnalogeInput05: double
  C1P29_AnalogeInput06: double

PDM_Analoge_3 = Simulink.Bus()
  C1P18_AnalogeInput09: double
  C1P19_AnalogeInput10: double
  C1P32_Analoge11: double
  C1P35_Analoge12: double

PDM_Status_3 = Simulink.Bus()
  ILVSystem: double
  TLVSystem: double
  VLVSystem: double
  C1P16_Digital: double
  C1P17_Digital: double
  C2P17_Digital: double
  C2P18_Digital: double
  C2P35_Status: double
  C2P36_Status: double
  C2P37_Status: double
  C2P38_Status: double

DDU7_Analoge_1 = Simulink.Bus()
  VDamperPotentiometerFR: double
  pBrakeR: double
  VDamperPotentiometerFL: double
  pBrakeF: double
  VDamperPotentiometerRR: double
  VDamperPotentiometerRL: double

rThrottlePedal1Gain = Simulink.Parameter(0.026)
rThrottlePedal2Gain = Simulink.Parameter(0.026, DataType="double")
pBrakeRGain = Simulink.Parameter(0.04)
rSteeringAngleGain = Simulink.Parameter(0.05)
aSteeringAngleMaxGain = Simulink.Parameter(0.275)
rRegenSensor1Gain = Simulink.Parameter(0.026)
rRegenSensor2Gain = Simulink.Parameter(0.026)
xDamperPotFRGain = Simulink.Parameter(0.025)
xDamperPotFLGain = Simulink.Parameter(0.025)
xDamperPotRLGain = Simulink.Parameter(0.025)
xDamperPotRRGain = Simulink.Parameter(0.025)
MTotalDischargeAllowed = 857
MTotalRegenAllowed = -653
zCoGHeight = Simulink.Parameter(0.26)
mCarMass = Simulink.Parameter(275)
lTrackWidth = Simulink.Parameter(1.24)
rLLTD = Simulink.Parameter(0.48)
DAirDensity = Simulink.Parameter(1.2)
AFrontalArea = Simulink.Parameter(1.2)
rCL = Simulink.Parameter(4.2)
rCoP = Simulink.Parameter(0.45)
FTyreVerticalStaticFL = Simulink.Parameter(660)
FTyreVerticalStaticFR = Simulink.Parameter(660)
FTyreVerticalStaticRL = Simulink.Parameter(715)
FTyreVerticalStaticRR = Simulink.Parameter(715)
rAckermann = Simulink.Parameter(-12)
lFrontDistanceCG = Simulink.Parameter(0.79)
lRearDistanceCG = Simulink.Parameter(0.73)
aToeFL = Simulink.Parameter(-1)
aToeFR = Simulink.Parameter(-1)
aToeRL = Simulink.Parameter(1)
aToeRR = Simulink.Parameter(1)
aKPIFront = Simulink.Parameter(8)
aCasterFront = Simulink.Parameter(5)
aRollGradient = Simulink.Parameter(1.4)
lVSALLatFront = Simulink.Parameter(2.1)
lVSALLatRear = Simulink.Parameter(1.4)
KWheelRateFront = Simulink.Parameter(35000)
KWheelRateRear = Simulink.Parameter(48000)
aCamberStaticFL = Simulink.Parameter(-1.3)
aCamberStaticFR = Simulink.Parameter(-1.3)
aCamberStaticRL = Simulink.Parameter(-1.3)
aCamberStaticRR = Simulink.Parameter(-1.3)
nRPMSpinningModeIntegralActivation = Simulink.Parameter(3000)
NSpinningModeKi = Simulink.Parameter(4)
NPCIntegralGainRegen = Simulink.Parameter(0.001)
PPCIntegralUpperLimitRegen = Simulink.Parameter(0)
PPCIntegralLowerLimitRegen = Simulink.Parameter(-10)
PPCProportionalUpperLimitRegen = Simulink.Parameter(0)
PPCProportionalLowerLimitRegen = Simulink.Parameter(-10)
NPCIntegralGainDischarge = Simulink.Parameter(0.001)
PPCIntegralUpperLimitDischarge = Simulink.Parameter(10)
PPCIntegralLowerLimitDischarge = Simulink.Parameter(-10)
PPCProportionalUpperLimitDischarge = Simulink.Parameter(10)
PPCProportionalLowerLimitDischarge = Simulink.Parameter(-10)
NTractionControlKd = Simulink.Parameter(0.1)
NABSKd = Simulink.Parameter(0.1)
IRegen6C = Simulink.Parameter(-72)
IRegen15C = -180
MTotalMinAllowed = Simulink.Parameter(-653)
MTotalMaxAllowed = Simulink.Parameter(857)

LimitationsBus = Simulink.Bus()
  BDischargeAllowed: boolean
  PInvTemperatureDerate: double
  PInvTemperatureDerateFR: double
  PInvTemperatureDerateFL: double
  PInvTemperatureDerateRR: double
  PInvTemperatureDerateRL: double
  PMotorTemperatureDerate: double
  PMotorTemperatureDerateFR: double
  PMotorTemperatureDerateFL: double
  PMotorTemperatureDerateRR: double
  PMotorTemperatureDerateRL: double
  PTSTemperatureDerateFR: double
  PTSTemperatureDerateFL: double
  PTSTemperatureDerateRR: double
  PTSTemperatureDerateRL: double
  PHighCellTemperatureDischargeDerate: double
  PHighCellTemperatureRegenDerate: double
  PLowCellVoltageDischargeDerate: double
  PSOCDischargeDerate: double
  PSOCRegenDerate: double
  rSpeedRegenDerateRR: double
  rSpeedRegenDerateRL: double
  rSpeedRegenDerateFR: double
  rSpeedRegenDerateFL: double
  rSpeedRegenDerate: double
  BSpeedDerateOn: boolean
  PDischargeDerate: double
  PRegenDerate: double
  BDamperOkFL: boolean
  BDamperOkFR: boolean
  BDamperOkRL: double
  BDamperOkRR: boolean
  BDamperOk: boolean
  BEncoderErrorRear: boolean
  BEncoderErrorFront: boolean

TorqueControlBus = Simulink.Bus()
  MDriverDischargeRequested: single
  PRegenRequested: double
  MDriverRegenRequested: double
  PDischargeLimit: double
  PPCIntegralTermDischarge: double
  PPCProportionalTermDischarge: double
  MPCDischargeRequested: double
  PRegenLimited: double
  PPCIntegralTermRegen: double
  PPCProportionalTermRegen: double
  MPCRegenRequested: double
  PPCDischargeRequested: double
  PPCRegenRequested: double
  MDischargeLimited: double
  MRegenLimited: double
  MDischargeRequested: double
  MRegenRequested: double
  BTorqueStatus: boolean
  MTotalRequested: double
  BESMDriverSignal1: double
  BEMSDriverSignal2: double
  BEMSDriverSignal3: double
  NLap: double
  NSectorGlobal: double
  NSectorLap: double
  ESector: double
  ERemaining: double
  EBudget: double
  sChassisSectorStart: double
  rSlipRatioFLActual: double
  rSlipRatioFRActual: double
  rSlipRatioRLActual: double
  rSlipRatioRRActual: double
  FLongitudinalLoadTransfer: double
  FTyreVerticalFL: double
  FTyreVericalFR: double
  FTyreVerticalRL: double
  FTyreVerticalRR: double
  aSlipAngleFL: double
  aSlipAngleFR: double
  aSlipAngleRL: double
  aSlipAngleRR: double
  aCamberFL: double
  aCamberFR: double
  aCamberRL: double
  aCamberRR: double
  FTotalLateralLoadTransfer: double
  FFrontLateralLoadTransfer: double
  FRearLateralLoadTransfer: double
  FTotalDownforce: double
  FFrontDownforce: double
  FRearDownforce: double
  aCamberGainSteerFL: double
  aCamberGainSteerFR: double
  aCamberGainRollFront: double
  aCamberGainRollRear: double
  xHeaveTravelFront: double
  xHeaveTravelRear: double
  aCamberGainHeaveFront: double
  aCamberGainHeaveRear: double
  aRollAngle: double
  nYawRateErrorActual: double
  BTorqueVectoringOK: boolean
  MTorqueVectoringFL: double
  MTorqueVectoringFR: double
  MTorqueVectoringRL: double
  MTorqueVectoringRR: double
  rSplitRear: double
  MTorqueDistributionFL: double
  MTorqueDistributionFR: double
  MTorqueDistributionRL: double
  MTorqueDistributionRR: double
  rSlipRatioOptimal: double
  MTractionControlFLTotal: double
  NTractionControlMultiplierFL: double
  NABSMultiplierFL: double
  MTractionControlFRTotal: double
  NTractionControlMultiplierFR: double
  NABSMultiplierFR: double
  MTractionControlRLTotal: double
  NTractionControlMultiplierRL: double
  NABSMultiplierRL: double
  MTractionControlRRTotal: double
  NTractionControlMultiplierRR: double
  NABSMultiplierRR: double
  NTractionControlPTermFL: double
  NTractionControlPTermFR: double
  NTractionControlPTermRL: double
  NTractionControlPTermRR: double
  NTractionControlDTermFL: double
  NTractionControlDTermFR: double
  NTractionControlDTermRL: double
  NTractionControlDTermRR: double
  NABSPTermFL: double
  NABSPTermFR: double
  NABSPTermRL: double
  NABSPTermRR: double
  NABSDTermFL: double
  NABSDTermFR: double
  NABSDTermRL: double
  NABSDTermRR: double
  MTractionControlFLFinal: double
  MTractionControlFRFinal: double
  MTractionControlRLFinal: double
  MTractionControlRRFinal: double
  MSpinningModeFL: double
  MSpinningModeFR: double
  MSpinningModeRL: double
  MSpinningModeRR: double
  MFLFinal: double
  MFRFinal: double
  MRLFinal: double
  MRRFinal: double
  MTotalFinal: double

SystemsBus = Simulink.Bus()
  rThrottlePedal1: double
  rThrottlePedal2: double
  rThrottlePedal: double
  BThrottleError: boolean
  tThrottleError: double
  pBrakeF: double
  pBrakeR: double
  BBrakeError: boolean
  tBrakeError: double
  BBrakeOn: boolean
  pBrakeMax: double
  BBrakeLight: boolean
  BPedalOverlap: boolean
  tPedalOverlap: double
  BAppsOK: boolean
  tAppsTimer: double
  rSteeringAngle: double
  aSteeringAngle: double
  rRegenPaddle: double
  BRegenOn: boolean
  xDamperFL: double
  xDamperFR: double
  xDamperRL: double
  xDamperRR: double
  BIMUOK: boolean
  vChassis: double
  sChassis: double
  BPageUp: boolean
  BPageDown: boolean
  BInvLVOn: boolean
  BCalibrationOn: boolean
  BReadyToDrive: boolean
  BErrorReset: boolean
  BTVOn: boolean
  BTCOn: boolean
  BDrivetrainCoolingOn: boolean
  BEMSOn: boolean
  BSpinningModeOn: boolean
  NThrottleMap: double
  PDischarge: double
  rTorqueSplit: double
  PRegen: double
  rTVMultiplier: double
  PEngineBraking: double
  rEngineBrakingSplit: double
  BDataMark: boolean
  rGrip: double
  EOffset: double
  NPage: double
  NTractionControlKpSelectorEM: double
  MRegenMax: double
  NEventMode: double
  NPCKpSelectorDischarge: double
  NPCKpSelectorRegen: double
  TMotorMax: double
  TInvMax: double
  BAccuFanOn: boolean
  BMotorFanOn: boolean
  BInverterFanOn: boolean
  BPCComplete: boolean
  PActual: double
  rSOC: double
  rSOE: double
  PEnergyMeter: double
  BOverpower: boolean