% Simulink data dictionary Master_Dictionary.sldd

rGearboxRatio = Simulink.Parameter(15.551)
rTyreRadius = Simulink.Parameter(0.203)
rThrottleCalHigh = Simulink.Parameter(103)
rThrottleCalLow = Simulink.Parameter(-3)
VThrottleErrorHigh = Simulink.Parameter(4900)
tSystemsTask = Simulink.Parameter(0.001)
pBrakeErrorLow = Simulink.Parameter(-10)
pBrakeErrorHigh = Simulink.Parameter(150)
pAppsBrakeThreshold = Simulink.Parameter(10)
pAppsThrottleThreshold = Simulink.Parameter(6.25)
rSteeringAngleCalHigh = Simulink.Parameter(100)
rSteeringAngleCalLow = Simulink.Parameter(-100)
VSteeringAngleHighSample = Simulink.Parameter(3700)
VSteeringAngleLowSample = Simulink.Parameter(1006)
aSteeringAngleMax = Simulink.Parameter(26.557)
rRegenPaddleCalHigh = Simulink.Parameter(103)
rRegenPaddleCalLow = Simulink.Parameter(-3)
VDamperErrorLow = Simulink.Parameter(0)
VDamperErrorHigh = Simulink.Parameter(4900)
tTorqueControlTask = Simulink.Parameter(0.001)
NKe = Simulink.Parameter(0.26)
MNominal = Simulink.Parameter(9.8)
rEMSTarget = Simulink.Parameter(-3.863)
IYawInertia = Simulink.Parameter(148.66)
rStraightSlipRatio = Simulink.Parameter(0.1)
tSpinLength = Simulink.Parameter(5)
MSpin = Simulink.Parameter(5)
nRPMSpinningModelIntegralActivation = Simulink.Parameter(1000)
NSpinningModelKi = Simulink.Parameter(0.05)
IMaxAllowed = Simulink.Parameter(195)
nMotorMax = Simulink.Parameter(22500)
v1stTorqueSplitAdjustment = Simulink.Parameter(4)
PPowerControllerActivation = Simulink.Parameter(70)
VThrottle1LowSample = Simulink.Parameter(830)
rThrottleOverlapThreshold = Simulink.Parameter(0)
VThrottle2HighSample = Simulink.Parameter(3230)
VThrottle2LowSample = Simulink.Parameter(350)
VThrottle1HighSample = Simulink.Parameter(4600)
VRegenPaddle1LowSample = Simulink.Parameter(1.4)
VRegenPaddle1HighSample = Simulink.Parameter(1.5)
VRegenPaddle2LowSample = Simulink.Parameter(1.4)
VRegenPaddle2HighSample = Simulink.Parameter(1.5)
pBrakeOverlapThreshold = Simulink.Parameter(1.5)
InverterRRBus = Simulink.Signal()
PPowerControllerProportionalLowerLimit = Simulink.Parameter(-10)
NPowerControllerIntegralGain = Simulink.Parameter(0.05)
PPowerControllerIntegralTermActivation = Simulink.Parameter(70)
PPowerControllerIntegralLowerLimit = Simulink.Parameter(-8)
PPowerControllerProportionalUpperLimit = Simulink.Parameter(6)
PPowerControllerIntegralUpperLimit = Simulink.Parameter(3)
lWheelbase = Simulink.Parameter(1.535)
FStaticWeightFront = Simulink.Parameter(927)
FStaticWeightRear = Simulink.Parameter(2163)
tTorqueVectoringErrorCorrection = Simulink.Parameter(0.3)
tMaxRegen = Simulink.Parameter(1.9)
IRegen2C = Simulink.Parameter(-27.2)
aSteeringAngleMaxGain = Simulink.Parameter(0.275)
xDamperPotFRGain = Simulink.Parameter(0.025)
xDamperPotFLGain = Simulink.Parameter(0.025)
xDamperPotRLGain = Simulink.Parameter(0.025)
xDamperPotRRGain = Simulink.Parameter(0.025)
zCoGHeight = Simulink.Parameter(0.26)
mCarMass = Simulink.Parameter(275)
lTrackWidth = Simulink.Parameter(1.24)
rLLTD = Simulink.Parameter(0.48)
DAirDensity = Simulink.Parameter(1.2)
AFrontalArea = Simulink.Parameter(1.2)
rCL = Simulink.Parameter(4.2)
rCoP = Simulink.Parameter(0.45)
rAckermann = Simulink.Parameter(-12)
lFrontDistanceCG = Simulink.Parameter(0.79)
lRearDistanceCG = Simulink.Parameter(0.73)
aToeFL = Simulink.Parameter(-1)
aToeFR = Simulink.Parameter(-1)
aToeRL = Simulink.Parameter(1)
aToeRR = Simulink.Parameter(1)
aKPIFront = Simulink.Parameter(8)
aCasterFront = Simulink.Parameter(5)
aRollGradient = Simulink.Parameter(1.4)
lVSALLatFront = Simulink.Parameter(2.1)
lVSALLatRear = Simulink.Parameter(1.4)
KWheelRateFront = Simulink.Parameter(35000)
KWheelRateRear = Simulink.Parameter(48000)
aCamberStaticFL = Simulink.Parameter(-1.3)
aCamberStaticFR = Simulink.Parameter(-1.3)
aCamberStaticRL = Simulink.Parameter(-1.3)
aCamberStaticRR = Simulink.Parameter(-1.3)
nRPMSpinningModeIntegralActivation = Simulink.Parameter(3000)
NPCIntegralGainRegen = Simulink.Parameter(0.001)
NPCIntegralGainDischarge = Simulink.Parameter(0.001)
PPCIntegralUpperLimitDischarge = Simulink.Parameter(10)
PPCIntegralLowerLimitDischarge = Simulink.Parameter(-10)
PPCProportionalUpperLimitDischarge = Simulink.Parameter(10)
PPCProportionalLowerLimitDischarge = Simulink.Parameter(-10)
NTractionControlKd = Simulink.Parameter(0.1)
NABSKd = Simulink.Parameter(0.1)
IRegen6C = Simulink.Parameter(-72)
IRegen15C = -180
MTotalMinAllowed = Simulink.Parameter(-653)
MTotalMaxAllowed = Simulink.Parameter(857)
VThrottleErrorLow = Simulink.Parameter(100)
VBrakeErrorLow = Simulink.Parameter(100)
VBrakeErrorHigh = Simulink.Parameter(4900)
rRegenPaddleOverlapThreshold = Simulink.Parameter(10)
QAccumulatorCapacity = Simulink.Parameter(43200)
EAccumulatorCapacity = Simulink.Parameter(21902400)

InverterFL = Simulink.Bus()
  nMotorFL: double
  BInvDCOnFLIn: boolean
  BInvErrorFL: boolean
  BInvOnFLIn: boolean
  BInvQuitDcOnFL: boolean
  BQuitInvOnFL: boolean
  BInvSysReadyFL: boolean
  BInvWarnFL: boolean
  MMotorMeasuredFL: double
  NInvDTCFL: double
  TMotorFL: double
  VDCInvFL: double
  TInvFL: double

InverterFR = Simulink.Bus()
  nMotorFR: double
  BInvDCOnFRIn: boolean
  BInvErrorFR: boolean
  BInvOnFRIn: boolean
  BInvQuitDcOnFR: boolean
  BQuitInvOnFR: boolean
  BInvSysReadyFR: boolean
  BInvWarnFR: boolean
  MMotorMeasuredFR: double
  NInvDTCFR: double
  TMotorFR: double
  VDCInvFR: double
  TInvFR: double

InverterRL = Simulink.Bus()
  nMotorRL: double
  BInvDCOnRLIn: boolean
  BInvErrorRL: boolean
  BInvOnRLIn: boolean
  BInvQuitDcOnRL: boolean
  BQuitInvOnRL: boolean
  BInvSysReadyRL: boolean
  BInvWarnRL: boolean
  MMotorMeasuredRL: double
  NInvDTCRL: double
  TMotorRL: double
  VDCInvRL: double
  TInvRL: double

InverterRR = Simulink.Bus()
  nMotorRR: double
  BInvDCOnRRIn: boolean
  BInvErrorRR: boolean
  BInvOnRRIn: boolean
  BInvQuitDcOnRR: boolean
  BQuitInvOnRR: boolean
  BInvSysReadyRR: boolean
  BInvWarnRR: boolean
  MMotorMeasuredRR: double
  NInvDTCRR: double
  TMotorRR: double
  VDCInvRR: double
  TInvRR: double

CAN1_2Bus = Simulink.Bus()
  InverterFL: Bus: InverterFL
  InverterFR: Bus: InverterFR
  InverterRL: Bus: InverterRL
  InverterRR: Bus: InverterRR

BMS = Simulink.Bus()
  IIVTS: double
  IBMSHallEffect: double
  VDCAccumulator: double
  TCellMin: double
  VCellAverage: double
  VCellMax: double
  TCellMax: double
  IBMSDLC: double
  VCellMin: double
  RCellAverage: double
  BBalancingOn: boolean
  BBMSP0A0C: boolean
  BBMSP0A0E: boolean
  BBMSP0A10: boolean
  BBMSP0A80: boolean
  BBMSP0AC0: boolean
  BBMSP0AFA: boolean

DDU7 = Simulink.Bus()
  NDisplayNumberDDU7: double
  VSteeringAngle: double
  VThrottlePedal1: double
  VThrottlePedal2: double
  VBrakeF: double
  VBrakeR: double
  VDamperPotentiometerFR: double
  VDamperPotentiometerFL: double

IMU = Simulink.Bus()
  vLateralIMU: double
  gVerticalIMU: double
  vLongitudinalIMU: double
  gLateralIMU: double
  gLongitudinalIMU: double
  nYawRateIMU: double

STW = Simulink.Bus()
  BSteeringWheelButton1: boolean
  BSteeringWheelButton2: boolean
  BSteeringWheelButton3: boolean
  BSteeringWheelButton4: boolean
  NPageSelectRotary: double
  NParameterRotary: double
  NEventModeRotary: double
  VRegenPaddle1: double
  VRegenPaddle2: double

CAN3Bus = Simulink.Bus()
  STW: Bus: STW
  DDU7: Bus: DDU7
  IMU: Bus: IMU

InverterRLSignals = Simulink.Bus()
  nMotorRL: double
  BInvDCOnRLIn: boolean
  BInvErrorRL: boolean
  BInvOnRLIn: boolean
  BInvQuitDcOnRL: boolean
  BQuitInvOnRL: boolean
  BInvSysReadyRL: boolean
  BInvWarnRL: boolean
  MMotorMeasuredRL: double
  NInvDTCRL: double
  TMotorRL: double
  VDCInvRL: double
  TInvRL: double

InverterFRSignals = Simulink.Bus()
  nMotorFR: double
  BInvDCOnFRIn: boolean
  BInvErrorFR: boolean
  BInvOnFRIn: boolean
  BInvQuitDcOnFR: boolean
  BQuitInvOnFR: boolean
  BInvSysReadyFR: boolean
  BInvWarnFR: boolean
  MMotorMeasuredFR: double
  NInvDTCFR: double
  TMotorFR: double
  VDCInvFR: double
  TInvFR: double

InverterFLSignals = Simulink.Bus()
  nMotorFL: double
  BInvDCOnFLIn: boolean
  BInvErrorFL: boolean
  BInvOnFLIn: boolean
  BInvQuitDcOnFL: boolean
  BQuitInvOnFL: boolean
  BInvSysReadyFL: boolean
  BInvWarnFL: boolean
  MMotorMeasuredFL: double
  NInvDTCFL: double
  TMotorFL: double
  VDCInvFL: double
  TInvFL: double

InverterRRSignals = Simulink.Bus()
  nMotorRR: double
  BInvDCOnRRIn: boolean
  BInvErrorRR: boolean
  BInvOnRRIn: boolean
  BInvQuitDcOnRR: boolean
  BQuitInvOnRR: boolean
  BInvSysReadyRR: boolean
  BInvWarnRR: boolean
  MMotorMeasuredRR: double
  NInvDTCRR: double
  TMotorRR: double
  VDCInvRR: double
  TInvRR: double

InverterSignals = Simulink.Bus()
  InverterRLSignals: Bus: InverterRLSignals
  InverterFLSignals: Bus: InverterFLSignals
  InverterRRSignals: Bus: InverterRRSignals
  InverterFRSignals: Bus: InverterFRSignals

WheelSpeeds = Simulink.Bus()
  vWheelRL: double
  vWheelRR: double
  vWheelFL: double
  vWheelFR: double

SensorSignals = Simulink.Bus()
  VDamperPotentiometerFL: double
  VDamperPotentiometerFR: double
  NDisplayNumberDDU7: double
  VSteeringAngle: double
  VThrottlePedal1: double
  VThrottlePedal2: double
  BSteeringWheelButton1: boolean
  BSteeringWheelButton2: boolean
  BSteeringWheelButton3: boolean
  BSteeringWheelButton4: boolean
  NPageSelectRotary: double
  NParameterRotary: double
  NEventModeRotary: double
  VRegenPaddle1: double
  VRegenPaddle2: double
  VBrakeF: double
  VBrakeR: double

pBrakeGain = Simulink.Parameter(0.04)
PPCProportionalUpperLimitRegen = Simulink.Parameter(10)
PPCProportionalLowerLimitRegen = Simulink.Parameter(0)
PPCIntegralUpperLimitRegen = Simulink.Parameter(10)
PPCIntegralLowerLimitRegen = Simulink.Parameter(0)
NEnduranceLaps = Simulink.Parameter(28)
tSlipRatioDerivativeFilterCutoff = Simulink.Parameter(0.1)
NSpinningModelKp = Simulink.Parameter(0.02)
nTargetRPM = Simulink.Parameter(5000)
NSpinningModeKi = Simulink.Parameter(0.01)

Global = Simulink.Bus()
  InverterSignals: Bus: InverterSignals
  WheelSpeeds: Bus: WheelSpeeds
  SensorSignals: Bus: SensorSignals
  GPSIMUSignals: Bus: GPSIMUSignals
  BMSSignals: Bus: BMSSignals
  Systems: Bus: Systems
  Stateflow: Bus: Stateflow
  Limitations: Bus: Limitations
  TorqueControl: Bus: TorqueControl

Stateflow = Simulink.Bus()
  NCarState: double
  BReadyToDriveBuzzer: boolean
  BReadyToDrive: boolean
  NBMSState: double
  NInvState: double
  BHVOn: double
  BInvOnRLOut: double
  BInvOnRROut: double
  BInvOnFLOut: double
  BInvOnFROut: double
  BInvDCOnRLOut: double
  BInvDCOnRROut: double
  BInvDCOnFLOut: double
  BInvDCOnFROut: double
  BInvEnableRL: double
  BInvEnableRR: double
  BInvEnableFL: double
  BInvEnableFR: double
  BInvErrorResetRL: double
  BInvErrorResetRR: double
  BInvErrorResetFL: double
  BInvErrorResetFR: double
  MTargetTorqueRL: double
  MTargetTorqueRR: double
  MTargetTorqueFL: double
  MTargetTorqueFR: double
  MTorqueLimitNegativeRL: double
  MTorqueLimitNegativeRR: double
  MTorqueLimitNegativeFL: double
  MTorqueLimitNegativeFR: double
  MTorqueLimitPositiveRL: double
  MTorqueLimitPositiveRR: double
  MTorqueLimitPositiveFL: double
  MTorqueLimitPositiveFR: double

Limitations = Simulink.Bus()
  BDischargeAllowed: boolean
  PInvTemperatureDerate: double
  PInvTemperatureDerateFR: double
  PInvTemperatureDerateFL: double
  PInvTemperatureDerateRR: double
  PInvTemperatureDerateRL: double
  PMotorTemperatureDerate: double
  PMotorTemperatureDerateFR: double
  PMotorTemperatureDerateFL: double
  PMotorTemperatureDerateRR: double
  PMotorTemperatureDerateRL: double
  PTSTemperatureDerateFR: double
  PTSTemperatureDerateFL: double
  PTSTemperatureDerateRR: double
  PTSTemperatureDerateRL: double
  PHighCellTemperatureDerate: double
  PLowCellVoltageDischargeDerate: double
  PHighCellVoltageRegenDerate: double
  PSOCDischargeDerate: double
  PSOCRegenDerate: double
  rSpeedRegenDerateRR: double
  rSpeedRegenDerateRL: double
  rSpeedRegenDerateFR: double
  rSpeedRegenDerateFL: double
  BSpeedDerateOn: boolean
  PDischargeDerate: double
  PRegenDerate: double

GPSIMUSignals = Simulink.Bus()
  vLateralIMU: double
  gVerticalIMU: double
  vLongitudinalIMU: double
  gLateralIMU: double
  gLongitudinalIMU: double
  nYawRateIMU: double

BMSSignals = Simulink.Bus()
  VCellMax: double
  VCellDelta: double
  VCellMin: double
  VCellAverage: double
  TCellMax: double
  IBMSDLC: double
  TCellMin: double
  IBMSHallEffect: double
  VDCAccumulator: double
  RCellAverage: double
  BBalancingOn: boolean
  BBMSP0A0C: boolean
  BBMSP0A0E: boolean
  BBMSP0A10: boolean
  BBMSP0A80: boolean
  BBMSP0AC0: boolean
  BBMSP0AFA: boolean
  IIVTS: double

PRulesLimit = Simulink.Parameter(80)
rThrottleDeltaError = Simulink.Parameter(60)
rThrottlePedal1Gain = Simulink.Parameter(0.10612244898)
rThrottlePedal2Gain = Simulink.Parameter(0.03714285714, DataType="double")
rRegenSensorGain = Simulink.Parameter(0.04)
rSteeringAngleGain = Simulink.Parameter(0.06353349282)

TorqueControl = Simulink.Bus()
  MDriverDischargeRequested: double
  PRegenRequested: double
  MDriverRegenRequested: double
  PDischargeLimit: double
  PPCIntegralTermDischarge: double
  PPCProportionalTermDischarge: double
  MPCDischargeRequested: double
  PRegenLimit: double
  PPCIntegralTermRegen: double
  PPCProportionalTermRegen: double
  MPCRegenRequested: double
  PPCDischargeRequested: double
  PPCRegenRequested: double
  MDischargeLimited: double
  MRegenLimited: double
  MTotalRequested: double
  BEMSDriverSignal1: boolean
  BEMSDriverSignal2: boolean
  BEMSDriverSignal3: boolean
  NLap: double
  NSectorGlobal: double
  NSectorLap: double
  ESector: double
  ERemaining: double
  EBudget: double
  sSector: double
  rSlipRatioFLActual: double
  rSlipRatioFRActual: double
  rSlipRatioRLActual: double
  rSlipRatioRRActual: double
  FLongitudinalLoadTransfer: double
  FTyreVerticalFL: double
  FTyreVerticalFR: double
  FTyreVerticalRL: double
  FTyreVerticalRR: double
  aSlipAngleFL: double
  aSlipAngleFR: double
  aSlipAngleRL: double
  aSlipAngleRR: double
  aCamberFL: double
  aCamberFR: double
  aCamberRL: double
  aCamberRR: double
  FTotalLateralLoadTransfer: double
  FLateralLoadTransferF: double
  FLateralLoadTransferR: double
  FTotalDownforce: double
  FDownforceF: double
  FDownforceR: double
  aCamberGainSteerFL: double
  aCamberGainSteerFR: double
  aCamberGainRollF: double
  aCamberGainRollR: double
  xHeaveTravelF: double
  xHeaveTravelR: double
  aCamberGainHeaveF: double
  aCamberGainHeaveR: double
  aRollAngle: double
  nYawRateErrorActual: double
  BTVOK: boolean
  MTorqueVectoringFL: double
  MTorqueVectoringFR: double
  MTorqueVectoringRL: double
  MTorqueVectoringRR: double
  rSplitRear: double
  MTorqueDistributionFL: double
  MTorqueDistributionFR: double
  MTorqueDistributionRL: double
  MTorqueDistributionRR: double
  rSlipRatioOptimal: double
  NTractionControlMultiplierFL: double
  NTractionControlMultiplierFR: double
  NTractionControlMultiplierRL: double
  NTractionControlMultiplierRR: double
  NABSMultiplierFL: double
  NABSMultiplierFR: double
  NABSMultiplierRL: double
  NABSMultiplierRR: double
  NSector1Remaining: double
  NSector2Remaining: double
  NSector3Remaining: double
  NSector4Remaining: double
  NSector5Remaining: double
  NSector6Remaining: double
  NSector7Remaining: double
  NSector8Remaining: double
  NSector9Remaining: double
  NSector10Remaining: double
  NSector11Remaining: double
  NSector12Remaining: double
  ETotalRequested: double
  ESector1Remaining: double
  ESector2Remaining: double
  ESector3Remaining: double
  MTractionControlFLTotal: double
  MTractionControlFRTotal: double
  MTractionControlRLTotal: double
  MTractionControlRRTotal: double
  ESector4Remaining: double
  ESector5Remaining: double
  ESector6Remaining: double
  ESector7Remaining: double
  ESector8Remaining: double
  ESector9Remaining: double
  ESector10Remaining: double
  ESector11Remaining: double
  ESector12Remaining: double
  MFLFinal: double
  MFRFinal: double
  MRLFinal: double
  MRRFinal: double
  MTotalFinal: double
  PDischargeLimited: double

FTyreVerticalStaticFL = Simulink.Parameter(412.5)
FTyreVerticalStaticFR = Simulink.Parameter(412.5)
FTyreVerticalStaticRL = Simulink.Parameter(962.5)
FTyreVerticalStaticRR = Simulink.Parameter(962.5)
MMotorMaxAllowed = Simulink.Parameter(204.8)
MMotorMinAllowed = Simulink.Parameter(-153.1)
PMotorMaxAllowed = Simulink.Parameter(28500)

Systems = Simulink.Bus()
  rThrottlePedal1: double
  rThrottlePedal: double
  BThrottleError: boolean
  tThrottleError: double
  pBrakeF: double
  pBrakeR: double
  BBrakeError: boolean
  tBrakeError: double
  BBrakeOn: boolean
  pBrakeMax: double
  BBrakeLight: boolean
  BPedalOverlap: boolean
  tPedalOverlap: double
  BAppsOK: boolean
  tAppsTimer: double
  rSteeringAngle: double
  aSteeringAngle: double
  rRegenPaddle: double
  BRegenOn: boolean
  xDamperFL: double
  xDamperFR: double
  xDamperRL: double
  xDamperRR: double
  BxDamperFLOk: boolean
  BxDamperFROk: boolean
  BxDamperRLOk: boolean
  BxDamperRROk: boolean
  BInverterErrorRear: boolean
  BInverterErrorFront: boolean
  BIMUOK: boolean
  BIMUError: boolean
  vChassis: double
  sChassis: double
  BPageUp: boolean
  BPageDown: boolean
  BInvLVOn: boolean
  BCalibrationOn: boolean
  BReadyToDriveButton: boolean
  BErrorReset: boolean
  BTVOn: boolean
  BTCOn: boolean
  BDrivetrainCoolingOn: boolean
  BEMSOn: boolean
  BSpinningModeOn: boolean
  NThrottleMap: double
  PDischargeMax: double
  rTorqueSplit: double
  PRegenMax: double
  rTVMultiplier: double
  PEngineBraking: double
  rEngineBrakingSplit: double
  BDataMark: boolean
  rGrip: double
  EOffset: double
  NTCKdSelector: double
  MRegenMax: double
  NEventMode: double
  NPCKpSelector: double
  TMotorMax: double
  TInvMax: double
  BAccuFanOn: boolean
  BMotorRBHFanOn: boolean
  BInverterFanOn: boolean
  BPCComplete: boolean
  PActual: double
  rSOC: double
  rSOE: double
  PEnergyMeter: double
  BOverpower: boolean
  tIMUError: double
  BTVOnEM: double
  BTCOnEM: double
  BDrivetrainCoolingOnEM: double
  BEMSOnEM: double
  BSpinningModeOnEM: double
  rTVMultiplierEM: double
  rEngineBrakingSplitEM: double
  NThrottleMapEM: double
  PDischargeMaxEM: double
  rTorqueSplitEM: double
  PRegenMaxEM: double
  PEngineBrakingEM: double
  BTVOnOW: double
  BTCOnOW: double
  BDrivetrainCoolingOnOW: double
  BEMSOnOW: double
  BSpinningModeOnOW: double
  rTVMultiplierOW: double
  rEngineBrakingSplitOW: double
  NThrottleMapOW: double
  PDischargeMaxOW: double
  rTorqueSplitOW: double
  PRegenMaxOW: double
  PEngineBrakingOW: double
  MMotorMaxFL: double
  MMotorMaxFR: double
  MMotorMaxRL: double
  MMotorMaxRR: double

CAN_MESSAGE_BUS = Simulink.Bus()
  Extended: uint8
  Length: uint8
  Remote: uint8
  Error: uint8
  ID: uint32
  Timestamp: double
  Data: uint8[8]

CANMessage = Simulink.Bus()
  ID: uint32
  Extended: boolean
  Remote: boolean
  Error: boolean
  Length: double
  Data: uint8[8]

CAN_MESSAGE_def = Simulink.Bus()
  ID: uint32
  Extended: boolean
  Remote: boolean
  Error: boolean
  Length: double
  Data: uint8[8]

SoCData = Simulink.AliasType(BaseType="double")
blk = "ENV/Model"
i = 1
isCommented = "off"
missing = {"MASTER.slx"}
modelName = "MASTER.slx"
models = {"WheelSpeedInputs"; "InverterInputs"; "BMSInputs"; "SensorInputs"; "GPSIMUInputs"; "INPUT"; "BAllowTorque"; "PInvTemperatureDerate"; "PSOCDerate"; "PHighCellTemperatureDerate"; "PCellVoltageDerate"; "rSpeedRegenDerate"; "PMotorTemperatureDerate"; "PDischargeDerate"; "PRegenDerate"; "PTSTemperatureDerate"; "LIMITATIONS"; "NCarState"; "NBMSState"; "NInvState"; "STATEFLOW"; "rThrottle"; "BThrottleError"; "SteeringWheel"; "TractiveSystemTemperatures"; "PActual"; "rSOC"; "BBrakeLight"; "BPCComplete"; "BDrivetrainCoolingOn"; "pBrake"; "BIMUOk"; "BDamperOk"; "BBrakeError"; "BInverterError"; "MMotorMax"; "xDamper"; "PEnergyMeter"; "BPedalOverlap"; "BAppsOK"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}
refBlocks = {"ENV/Model"}
refModelNames = {"MASTER.slx"}

rteEvent = Simulink.Bus()
  name: uint16[64]
  type: uint32
  index: uint32
  custom: uint32

rteSubTask = Simulink.Bus()
  name: uint8[256]
  type: uint32
  idx: uint32

rteTask = Simulink.Bus()
  idx: uint32
  name: uint8[64]
  color: double[3]
  type: uint32
  customEventID: uint32
  taskPriority: double
  clockMultiple: uint32
  core: int32
  preemptible: boolean
  runnableIDs: uint32[1 256]
  runnableWireless: boolean[1 256]
  runnableDurationsMean: double[1 256]
  runnableDurations: double[1 256]
  runnableDurationsVar: double[1 256]
  currentRunnableID: uint32
  currentRunnableStartTime: double
  currentRunnableRemTime: double
  currAssignedCore: int32
  prevAssignedCore: int32
  wasPreempted: boolean

STM32H7_Config = Simulink.ConfigSet(StartTime="0", StopTime="1", FixedStep="0.001", Solver="FixedStepDiscrete", ProdHWDeviceType="ARM Compatible->ARM Cortex-M", SystemTargetFile="ert.tlc", HardwareBoard="STM32H7xx Based (Single-core)", TargetLang="C")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